# Grasshopper definition combineTest.gh (Grasshopper 1.0.7)
# plug-ins: CavernVoxel

panel = Panel("C:\Users\r.hudson\Documents\WORK\projects\passageProjects\caveparts")
brep = Brep([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])
cvox = CombineModelRefs(
    FolderWithFilesToReference=panel,
    SearchString="_3d",
    OutputFileName="combined.3dm",
    Run=Toggle(False),
    ReferenceGeometry=brep)
